# Grasshopper definition Frame.gh (Grasshopper 1.0.8)

outer_dimension = Slider(200, range=0..1000)
outer_thickness = Slider(8, range=0..10)
center_circle = Slider(10, range=0..100)
length = Slider(2, range=0..10)
vertical_factor = Slider(0.3, range=0..10)
width = Slider(4, range=0..100)
fillet_radius = Slider(1, range=0..10)
corner_radial_gap = Slider(0.2, range=0..1)
cross_thickness = Slider(3, range=0..10)
height = Slider(20, range=0..100)
magnet_radius = Slider(5, range=2..10)
magnet_thickness = Slider(2, range=0..10)

# ---- group: Slicing the detailed buildings from 3DM
number_slider = Slider(200, range=0..1000)  # disabled
import_3dm = Import3DM(
    File="/Users/ssanjay/Library/CloudStorage/OneDrive-Chalmers/Desktop/postdoc/MRTable/BuildingBrep.3dm",
    Layer="*",
    Name="*")  # disabled
rectangle = Rectangle(Plane=PlaneXY(0, 0, 0), XSize=number_slider, YSize=number_slider, Radius=0)  # -> Rectangle, Length; disabled
number_slider_2 = Slider(3, range=0..10)  # disabled
number_slider_3 = Slider(5, range=0..10)  # disabled
domain_box = DomainBox(Base=PlaneXY(0, 0, 0), X=number_slider, Y=number_slider, Z=number_slider)  # disabled
rectangular_array = RectangularArray(Geometry=domain_box, Cell=rectangle.Rectangle, XCount=number_slider_2, YCount=number_slider_3)  # -> Geometry, Transform; disabled
solid_intersection = SolidIntersection(BrepsA=import_3dm, BrepsB=rectangular_array.Geometry)  # disabled
mesh = Mesh(solid_intersection)  # disabled

# ----
cluster = Cluster(
    outer_dimension=outer_dimension,
    outer_thickness=outer_thickness,
    corner_radial_gap=corner_radial_gap,
    cross_thickness=cross_thickness,
    height=height,
    magnet_radius=magnet_radius,
    magnet_thickness=magnet_thickness,
    center_circle=center_circle,
    connector_length=length,
    connector_vertical_factor=vertical_factor,
    connector_width=width,
    connector_fillet_radius=fillet_radius)  # -> base_tile_2, instanced_connectors_2, connector_2, capped_connector_2

# ---- group: Instancing the connectors
capped_connector = Brep(cluster.capped_connector_2)
connector = Brep(cluster.connector_2)
rectangle_2 = Rectangle(Plane=PlaneXY(0, 0, 0), XSize=Slider(10, range=0..100), YSize=Slider(13, range=0..100), Radius=0)  # -> Rectangle, Length
rectangular_array_2 = RectangularArray(Geometry=connector, Cell=rectangle_2.Rectangle, XCount=Slider(8, range=0..10), YCount=Slider(3, range=0..10))  # -> Geometry, Transform
rectangular_array_3 = RectangularArray(Geometry=capped_connector, Cell=rectangle_2.Rectangle, XCount=Slider(8, range=0..10), YCount=Slider(2, range=0..10))  # -> Geometry, Transform
unit_y = UnitY(Factor="-50")
unit_y_2 = UnitY(Factor="-100")
move = Move(Geometry=rectangular_array_2.Geometry, Motion=unit_y)  # -> Geometry, Transform
move_2 = Move(Geometry=rectangular_array_3.Geometry, Motion=unit_y_2)  # -> Geometry, Transform

# ---- group: Instancing the tiles
number_of_vertical_tiles = Panel("""3
2
3
3
2
3
2
3
3
2
2
3
2
2
2""")
number_slider_4 = Slider(5, range=0..10)
number_slider_5 = Slider(3, range=0..10)
rectangle_3 = Rectangle(Plane=PlaneXY(0, 0, 0), XSize=outer_dimension, YSize=outer_dimension, Radius=0)  # -> Rectangle, Length
rectangle_4 = Rectangle(Plane=PlaneXY(0, 0, 0), XSize=outer_dimension, YSize=outer_dimension, Radius=0)  # -> Rectangle, Length
series = Series(Start=0, Step=1, Count=number_of_vertical_tiles)
rectangular_array_4 = RectangularArray(Geometry=cluster.base_tile_2, Cell=rectangle_3.Rectangle, XCount=number_slider_5, YCount=number_slider_4)  # -> Geometry, Transform
rectangular_array_5 = RectangularArray(Geometry=cluster.instanced_connectors_2, Cell=rectangle_4.Rectangle, XCount=number_slider_5, YCount=number_slider_4)  # -> Geometry, Transform
multiplication = Multiplication(A=series, B=height)
unit_z = UnitZ(Factor=multiplication)
move_3 = Move(Geometry=graft(rectangular_array_4.Geometry), Motion=unit_z)  # -> Geometry, Transform
move_4 = Move(Geometry=graft(rectangular_array_4.Geometry), Motion=unit_z)  # -> Geometry, Transform
cull_index = CullIndex(List=move_3.Geometry, Indices="0", Wrap=True)
list_item = ListItem(List=move_3.Geometry, Index=0, Wrap=True)

# ----
custom_preview = CustomPreview(Geometry=cull_index, Material="yellow")
custom_preview_2 = CustomPreview(Geometry=list_item, Material="gray")
custom_preview_3 = CustomPreview(Geometry=rectangular_array_5.Geometry, Material="orange")
custom_preview_4 = CustomPreview(Geometry=cluster.base_tile_2, Material="yellow")
custom_preview_5 = CustomPreview(Geometry=cluster.instanced_connectors_2, Material="orange")
custom_preview_6 = CustomPreview(Geometry=move.Geometry, Material="blue")
custom_preview_7 = CustomPreview(Geometry=move_2.Geometry, Material="red")
custom_preview_8 = CustomPreview(Geometry=cluster.instanced_connectors_2, Material="orange")
custom_preview_9 = CustomPreview(Geometry=cluster.base_tile_2, Material="gray")

# ==== cluster Cluster
corner_radial_gap = ClusterInput()
magnet_thickness = ClusterInput()
outer_dimension = ClusterInput()
connector_length = ClusterInput()
connector_vertical_factor = ClusterInput()
connector_width = ClusterInput()
connector_fillet_radius = ClusterInput()
cross_thickness = ClusterInput()
outer_thickness = ClusterInput()
magnet_radius = ClusterInput()
center_circle = ClusterInput()
height = ClusterInput()
corner_radial_gap_2 = Number(corner_radial_gap)
magnet_thickness_2 = Number(magnet_thickness)
outer_dimension_2 = Number(outer_dimension)
connector_length_2 = Number(connector_length)
connector_vertical_factor_2 = Number(connector_vertical_factor)
connector_width_2 = Number(connector_width)
connector_fillet_radius_2 = Number(connector_fillet_radius)
cross_thickness_2 = Number(cross_thickness)
outer_thickness_2 = Number(outer_thickness)
magnet_radius_2 = Number(magnet_radius)
center_circle_2 = Number(center_circle)
height_2 = Number(height)
negative = Negative(Value=connector_length_2)
unit_y = UnitY(Factor=[connector_length_2, negative])
point = Point(Point(0, 0, 0))
negative_2 = Negative(Value=connector_width_2)
move = Move(Geometry=point, Motion=unit_y)  # -> Geometry, Transform
rectangle = Rectangle(Plane=PlaneXY(0, 0, 0), XSize=outer_dimension_2, YSize=outer_dimension_2, Radius=0)  # -> Rectangle, Length
unit_x = UnitX(Factor=[connector_width_2, negative_2])
subtraction = Subtraction(A=outer_thickness_2, B=corner_radial_gap_2)
subtraction_2 = Subtraction(A=outer_dimension_2, B=subtraction, C=connector_width_2)
negative_3 = Negative(Value=outer_thickness_2)
move_2 = Move(Geometry=move.Geometry, Motion=graft(unit_x))  # -> Geometry, Transform
multiplication = Multiplication(A=subtraction_2, B="0.7")
offset_curve = OffsetCurve(Curve=rectangle.Rectangle, Distance=expr("x/2", negative_3), Corners=1)
explode = Explode(Curve=offset_curve, Recursive=True)  # -> Segments, Vertices
offset_curve_2 = OffsetCurve(Curve=rectangle.Rectangle, Distance=negative_3, Corners=1)
division = Division(A=unit_y, B=connector_vertical_factor_2)
construct_domain = ConstructDomain(DomainStart=expr("-x", height_2), DomainEnd=expr("x+2", height_2))
division_2 = Division(A=multiplication, B="2")
subtraction_3 = Subtraction(A=height_2, B=magnet_thickness_2)
divide_curve = DivideCurve(Curve=explode.Segments, Count=Slider(4, range=0..10), Kinks=False)  # -> Points, Tangents, Parameters
unit_z = UnitZ(Factor=1)
explode_2 = Explode(Curve=offset_curve_2, Recursive=True)  # -> Segments, Vertices
unit_z_2 = UnitZ(Factor=subtraction_3)
move_3 = Move(Geometry=move_2.Geometry, Motion=division)  # -> flatten(Geometry), Transform
area = Area(Geometry=rectangle.Rectangle)  # -> Area, Centroid
cross_product = CrossProduct(VectorA=divide_curve.Tangents, VectorB=unit_z, Unitize=False)  # -> Vector, Length
panel = Panel("""1
3""")
panel_2 = Panel("""1
3""")
list_item = ListItem(List=divide_curve.Points, Index=panel, Wrap=True)
construct_plane = ConstructPlane(Origin=divide_curve.Points, XAxis=cross_product.Vector, YAxis=divide_curve.Tangents)
list_item_2 = ListItem(List=construct_plane, Index=panel_2, Wrap=True)
cull_index = CullIndex(List=explode_2.Vertices, Indices="0", Wrap=True)
move_4 = Move(Geometry=cull_index, Motion=unit_z_2)  # -> Geometry, Transform
list_item_3 = ListItem(List=move_3.Geometry, Index=0, Wrap=True)  # -> Item, Item1, Item2, Item3
list_item_4 = ListItem(List=move.Geometry, Index=0, Wrap=True)  # -> Item, Item1
unit_z_3 = UnitZ(Factor=height_2)
circle_cnr = CircleCNR(Center=area.Centroid, Normal=Vector(0, 0, 1), Radius=center_circle_2)
region_difference = RegionDifference(CurvesA=rectangle.Rectangle, CurvesB=offset_curve_2)
unit_z_4 = UnitZ(Factor="1")
center_box = CenterBox(Base=list_item_2, X=expr("(x/2)-2", outer_thickness_2), Y=expr("x/2", division_2), Z=construct_domain)
circle_cnr_2 = CircleCNR(Center=cull_index, Normal=Vector(0, 0, 1), Radius=subtraction)
panel_3 = Panel("""0
1
2
3
4
5
6
7
8
9
10
11""")
circle_cnr_3 = CircleCNR(Center=move_4.Geometry, Normal=Vector(0, 0, 1), Radius=magnet_radius_2)
offset_curve_3 = OffsetCurve(Curve=circle_cnr_3, Distance="-1", Corners=1)
merge = Merge(
    Data1=list_item_4.Item,
    Data2=list_item_3.Item,
    Data3=list_item_3.Item1,
    Data4=list_item_4.Item1,
    Data5=list_item_3.Item3,
    Data6=list_item_3.Item2)
circle_cnr_4 = CircleCNR(Center=[move_4.Geometry, cull_index], Normal=Vector(0, 0, 1), Radius=magnet_radius_2)
unit_z_5 = UnitZ(Factor=magnet_thickness_2)
multiplication_2 = Multiplication(A=magnet_thickness_2, B="2")
move_5 = Move(Geometry=offset_curve_3, Motion=unit_z_4)  # -> Geometry, Transform
fillet_edge = FilletEdge(Shape=center_box, Blend=0, Metric=0, Edges=panel_3, Radii="1")
boundary_surfaces = BoundarySurfaces(Edges=circle_cnr_2)
boundary_surfaces_2 = BoundarySurfaces(Edges=circle_cnr)
boundary_surfaces_3 = BoundarySurfaces(Edges=region_difference)
list_item_5 = ListItem(List=cull_index, Index=0, Wrap=True)  # -> Item, Item1, Item2, Item3
polyline = PolyLine(Vertices=merge, Closed=invert(False))
number_slider = Slider(20, range=0..100)
subtraction_4 = Subtraction(A=height_2, B=multiplication_2)
division_3 = Division(A=number_slider, B="2")
panel_4 = Panel("""1
-1""")
extrude = Extrude(Base=circle_cnr_4, Direction=unit_z_5)
division_4 = Division(A=cross_thickness_2, B="2")
circle_cnr_5 = CircleCNR(Center=area.Centroid, Normal=Vector(0, 0, 1), Radius=expr("x-3", center_circle_2))
addition = Addition(A=subtraction_4, B="2")
negative_4 = Negative(Value=division_3)
line = Line(StartPoint=list_item_5.Item, EndPoint=list_item_5.Item2)
line_2 = Line(StartPoint=list_item_5.Item1, EndPoint=list_item_5.Item3)
unit_z_6 = UnitZ(Factor=height_2)
multiplication_3 = Multiplication(A=panel_4, B=division_4)
fillet = Fillet(Curve=polyline, Radius=connector_fillet_radius_2)
cap_holes = CapHoles(Brep=extrude)
unit_y_2 = UnitY(Factor=negative_4)
domain_box = DomainBox(Base=PlaneXY(0, 0, 0), X=number_slider, Y=number_slider, Z=number_slider)
boundary_surfaces_4 = BoundarySurfaces(Edges=circle_cnr_5)
extrude_2 = Extrude(Base=fillet, Direction=unit_z_6)
offset_curve_4 = OffsetCurve(Curve=[line, line_2], Distance=graft(multiplication_3), Corners=1)  # -> flatten(Curve)
negative_5 = Negative(Value=addition)
move_6 = Move(Geometry=domain_box, Motion=unit_y_2)  # -> Geometry, Transform
unit_z_7 = UnitZ(Factor=negative_5)
extrude_3 = Extrude(Base=boundary_surfaces, Direction=unit_z_3)
extrude_4 = Extrude(Base=boundary_surfaces_2, Direction=unit_z_3)
extrude_5 = Extrude(Base=boundary_surfaces_3, Direction=unit_z_3)
extrude_6 = Extrude(Base=move_5.Geometry, Direction=unit_z_7)
cap_holes_2 = CapHoles(Brep=extrude_2)
list_item_6 = ListItem(List=offset_curve_4, Index=0, Wrap=True)  # -> Item, Item1, Item2, Item3
solid_difference = SolidDifference(BrepsA=cap_holes_2, BrepsB=move_6.Geometry)
solid_difference_2 = SolidDifference(BrepsA=extrude_5, BrepsB=flatten(fillet_edge))
cap_holes_3 = CapHoles(Brep=extrude_6)  # -> flatten(Brep)
explode_3 = Explode(Curve=rectangle.Rectangle, Recursive=True)  # -> Segments, Vertices
loft = Loft(
    Curves=[list_item_6.Item, list_item_6.Item2],
    Options={Adjust=False, Closed=False, LoftEnds=0, LoftSimp=0, LoftType=0, Rebuild=10, Refit=0.01})
loft_2 = Loft(
    Curves=[list_item_6.Item1, list_item_6.Item3],
    Options={Adjust=False, Closed=False, LoftEnds=0, LoftSimp=0, LoftType=0, Rebuild=10, Refit=0.01})
solid_union = SolidUnion(Breps=flatten([cap_holes_3, cap_holes]))
extrude_7 = Extrude(Base=boundary_surfaces_4, Direction=unit_z_3)
extrude_8 = Extrude(Base=[loft, loft_2], Direction=unit_z_3)
curve_middle = CurveMiddle(Curve=explode_3.Segments)
solid_union_2 = SolidUnion(Breps=extrude_8)
vector_2pt = Vector2Pt(PointA=point, PointB=curve_middle, Unitize=False)  # -> Vector, Length
solid_difference_3 = SolidDifference(BrepsA=solid_union_2, BrepsB=flatten([extrude_3, extrude_4]))
solid_difference_4 = SolidDifference(BrepsA=solid_difference_2, BrepsB=flatten([extrude_3, extrude_4]))
solid_difference_5 = SolidDifference(BrepsA=extrude_3, BrepsB=solid_union)
panel_5 = Panel("""pi/2
0
pi/2
0""")
move_7 = Move(Geometry=cap_holes_2, Motion=vector_2pt.Vector)  # -> Geometry, Transform
merge_2 = Merge(Data1=solid_difference_3, Data2=solid_difference_5, Data3=solid_difference_4, Data4=extrude_4)  # -> flatten(Result)
rotate = Rotate(Geometry=move_7.Geometry, Angle=panel_5, Plane=curve_middle)  # -> Geometry, Transform
solid_union_3 = SolidUnion(Breps=merge_2)
solid_difference_6 = SolidDifference(BrepsA=solid_union_3, BrepsB=rotate.Geometry)
solid_difference_7 = SolidDifference(BrepsA=solid_difference_6, BrepsB=extrude_7)
instanced_connectors = Brep(rotate.Geometry)
capped_connector = Brep(solid_difference)
connector = Brep(cap_holes_2)
base_tile = Brep(solid_difference_7)
base_tile_2 = ClusterOutput(base_tile)
connector_2 = ClusterOutput(connector)
instanced_connectors_2 = ClusterOutput(instanced_connectors)
capped_connector_2 = ClusterOutput(capped_connector)
